# Grasshopper definition SC_GML_FF.gh (Grasshopper 1.0.7)
# plug-ins: Magnetizing_FPG, TopologicGH, Pufferfish, Human, Hops

# ----
# Some
# internalized plans
curve = Curve([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])
curve_2 = Curve([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])
curve_3 = Curve([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])
curve_4 = Curve([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])
curve_5 = Curve([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])
# Model Verification
curve_6 = Curve([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])
# Draw curves in rhino
# and define them in grasshopper
# and let the script to the rest !
curve_7 = Curve([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])

room_count_configuration = Slider(1, range=0..5)
plot_x_factor = Slider(0.3, range=0.15..0.3)
entry_point_position = Slider(0.3, range=0..1)
plot_y_factor = Slider(0.2, range=0.15..0.3)

roominstance = RoomInstance()
roominstance_2 = RoomInstance()
roominstance_3 = RoomInstance()
roominstance_4 = RoomInstance()
roominstance_5 = RoomInstance()
roominstance_6 = RoomInstance()
roominstance_7 = RoomInstance()
# Dataset Generation
roominstance_8 = RoomInstance()
roominstance_9 = RoomInstance()
roominstance_10 = RoomInstance()
roominstance_11 = RoomInstance()
roominstance_12 = RoomInstance()
roominstance_13 = RoomInstance()
roominstance_14 = RoomInstance()
roominstance_15 = RoomInstance()
roominstance_16 = RoomInstance()
roominstance_17 = RoomInstance()
roominstance_18 = RoomInstance()
roominstance_19 = RoomInstance()
roominstance_20 = RoomInstance()
roominstance_21 = RoomInstance()
roominstance_22 = RoomInstance()
roominstance_23 = RoomInstance()
roominstance_24 = RoomInstance()
roominstance_25 = RoomInstance()
roominstance_26 = RoomInstance()
roominstance_27 = RoomInstance()
roominstance_28 = RoomInstance()
roominstance_29 = RoomInstance()
roominstance_30 = RoomInstance()
roominstance_31 = RoomInstance()
roominstance_32 = RoomInstance()
app_area = Panel("450")
app_area_2 = Panel("350")
app_area_3 = Panel("550")
app_area_4 = Panel("650")
app_area_5 = Panel("750")
app_area_6 = Panel("850")
roominstance_33 = RoomInstance()
stream_filter = StreamFilter(
    Gate=room_count_configuration,
    Stream0=app_area_2,
    Stream1=app_area,
    Stream2=app_area_3,
    Stream3=app_area_4,
    Stream4=app_area_5,
    Stream5=app_area_6)
multiplication = Multiplication(A=stream_filter, B=1.7)
entrance = GetNumber(entry_point_position, AtLeast=1, AtMost=1, Maximum=1.797693135e+308, Minimum=-1.797693135e+308, TreeAccess=False)
constrained_area_rectangle = ConstrainedAreaRectangle(Plane=PlaneXY(0, 0, 0), Area=multiplication, FactorX=plot_x_factor, FactorY=plot_y_factor)  # -> Rectangle, DimensionX, DimensionY
offset_curve = OffsetCurve(Curve=constrained_area_rectangle.Rectangle, Distance="-1", Corners=1)
panel = Panel("""1
0.5""")
dash_pattern = DashPattern(Curve=offset_curve, Pattern=panel)  # -> Dashes, Gaps
evaluate_curve = EvaluateCurve(Curve=reparameterize(offset_curve), Parameter=entrance)  # -> Point, Tangent, Angle
boundary = Curve(constrained_area_rectangle.Rectangle)
entrance_point = Point(evaluate_curve.Point)
custom_preview_lineweights = CustomPreviewLineweights(Geometry=boundary, Shader=ColourSwatch(SwatchColor=RGB(5, 0, 0)), Thickness=Slider(7, range=0..10), Absolute=False)
houseinstance = HouseInstance(Boundary=boundary, EntrancePoint=entrance_point)
houseinstance_2 = HouseInstance(Boundary=boundary, EntrancePoint=entrance_point)
houseinstance_3 = HouseInstance(Boundary=boundary, EntrancePoint=entrance_point)
houseinstance_4 = HouseInstance(Boundary=boundary, EntrancePoint=entrance_point)
houseinstance_5 = HouseInstance(Boundary=boundary, EntrancePoint=entrance_point)
houseinstance_6 = HouseInstance(Boundary=boundary, EntrancePoint=entrance_point)
stream_filter_2 = StreamFilter(
    Gate=room_count_configuration,
    Stream0=houseinstance,
    Stream1=houseinstance_2,
    Stream2=houseinstance_3,
    Stream3=houseinstance_4,
    Stream4=houseinstance_5,
    Stream5=houseinstance_6)

# ----
# Plot Viz
colour_swatch = ColourSwatch(SwatchColor=RGB(242, 178, 15))
sphere = Sphere(Base=entrance_point, Radius=Slider(0.5, range=0..1))
custom_preview = CustomPreview(Geometry=sphere, Material=colour_swatch)  # disabled
custom_preview_lineweights_2 = CustomPreviewLineweights(Geometry=dash_pattern.Dashes, Shader=ColourSwatch(SwatchColor=RGB(5, 0, 0)), Absolute=False)

# ----
# Preparing geometry for prediction
# (1- to corridor %)
# +
# to exterior %
# Room type
# Room Quality
# Room Area
# Room premiter
# Graph generation
# Graph export
# Room type
# Room Quality
# Room Area
curve_8 = Curve([<curve referenced from the Rhino model> x7])
unit_z = UnitZ(Factor=3.5)
panel_2 = Panel(" A problem here !")
panel_3 = Panel("""Min = 0
Max = 2 --""")
scoring_guide = Panel("""from 0 "worst"
Till 4 "best"
""")  # disabled
panel_4 = Panel("""Room type
0=Corridor
1= Room""")
panel_5 = Panel("""0
1""")
toggle = BooleanToggle(False)
path = FilePath("E:\IAAC\course\AI\graph\sample_auto\edge.csv")
colour_swatch_2 = ColourSwatch(SwatchColor=RGBA(36, 36, 36, 165))

region_union = RegionUnion(Curves=curve_8)
# Plan rooms ( rooms + corridors)
length = Length(Curve=region_union)
sort_list = SortList(Keys=length, ValuesValuesA=region_union)  # -> Keys, ValuesValuesA
list_item = ListItem(List=sort_list.ValuesValuesA, Index="-1", Wrap=True)
cull_index = CullIndex(List=sort_list.ValuesValuesA, Indices="-1", Wrap=True)
boundary_surfaces = BoundarySurfaces(Edges=cull_index)
boundary_surfaces_2 = BoundarySurfaces(Edges=curve_8)
area = Area(Geometry=boundary_surfaces_2)  # -> Area, Centroid
mass_addition = MassAddition(Input=area.Area)  # -> Result, PartialResults
area_2 = Area(Geometry=boundary_surfaces)  # -> Area, Centroid
addition = Addition(A=mass_addition.Result, B=area_2.Area)
division = Division(A=area_2.Area, B=addition)
multiplication_2 = Multiplication(A=division, B=100)

corridor = Brep(boundary_surfaces)
rooms = Brep(boundary_surfaces_2)
merge_faces = MergeFaces(Brep=rooms)  # -> Breps, Before, After
merge_faces_2 = MergeFaces(Brep=corridor)  # -> Breps, Before, After
merge = Merge(Data1=flatten(merge_faces_2.Breps), Data2=flatten(merge_faces.Breps))
extrude = Extrude(Base=merge, Direction=unit_z)
flatten_tree = FlattenTree(Tree=extrude, Path="{0}")
list_length = ListLength(List=boundary_surfaces_2)
topology_bygeometry = TopologyByGeometry(Geometry=extrude, Tolerance=0.0001)  # -> flatten(Topology)
list_item_2 = ListItem(List=flatten_tree, Index=0, Wrap=True)
cull_index_2 = CullIndex(List=flatten_tree, Indices=0, Wrap=True)
topology_cells = TopologyCells(Topology=topology_bygeometry)  # -> flatten(Cells)
cellcomplex_bycells = CellComplexByCells(Cells=topology_cells)
repeat_data = RepeatData(Data=Slider(1, range=0..1), Length=list_length)
cellcomplex_faces = CellComplexFaces(CellComplex=cellcomplex_bycells)
merge_2 = Merge(Data1=flatten(Slider(0, range=0..100)), Data2=flatten(repeat_data))
topology_geometry = TopologyGeometry(Topology=cellcomplex_faces, Tolerance=0.0001)  # -> flatten(Geometry)
area_3 = Area(Geometry=topology_geometry)  # -> Area, Centroid
deconstruct = Deconstruct(Point=area_3.Centroid)  # -> XComponent, YComponent, ZComponent
equality = Equality(FirstNumber=deconstruct.ZComponent, SecondNumber=0)  # -> Equality, Inequality
cull_pattern = CullPattern(List=cellcomplex_faces, CullPattern=equality.Equality)
list_item_3 = ListItem(List=topology_geometry, Index=0, Wrap=True)
topology_geometry_2 = TopologyGeometry(Topology=cull_pattern, Tolerance=0.0001)
face_sharededges = FaceSharedEdges(Face=cull_pattern, Face_2=cull_pattern)
list_item_4 = ListItem(List=flatten(topology_geometry_2), Index=0, Wrap=True)
topology_geometry_3 = TopologyGeometry(Topology=face_sharededges, Tolerance=0.0001)
trim_tree = TrimTree(Tree=topology_geometry_3, Depth=1)
tree_branch = TreeBranch(Tree=simplify(trim_tree), Path="{0}", MaintainPaths=True)
topology_geometry_4 = TopologyGeometry(Topology=cull_pattern, Tolerance=0.0001)  # -> simplify(Geometry)
join_curves = JoinCurves(Curves=tree_branch, Preserve=False)  # -> flatten(Curves)
curve_middle = CurveMiddle(Curve=trim_tree)
length_2 = Length(Curve=trim_tree)
list_length_2 = ListLength(List=trim_tree)
member_index = MemberIndex(Set=flatten(curve_middle), Member=flatten(curve_middle))  # -> Index, Count
mass_addition_2 = MassAddition(Input=length_2)  # -> Result, PartialResults
partition_list = PartitionList(List=member_index.Count, Size=flatten(list_length_2))
equality_2 = Equality(FirstNumber=partition_list, SecondNumber=2)  # -> Equality, Inequality
length_3 = Length(Curve=join_curves)
data = Data(mass_addition_2.Result)
sort_list_2 = SortList(Keys=length_3, ValuesValuesA=join_curves)  # -> Keys, ValuesValuesA
area_4 = Area(Geometry=topology_geometry_4)  # -> Area, Centroid
cull_pattern_2 = CullPattern(List=length_2, CullPattern=equality_2.Equality)
cull_pattern_3 = CullPattern(List=length_2, CullPattern=equality_2.Inequality)
cull_pattern_4 = CullPattern(List=curve_middle, CullPattern=equality_2.Equality)
cull_pattern_5 = CullPattern(List=curve_middle, CullPattern=equality_2.Inequality)
corridor_crv = Curve(sort_list_2.ValuesValuesA)
point_list = PointList(Points=flatten(area_4.Centroid), Size=Slider(4, range=0..10))
edge_length_to_exterior = Data(cull_pattern_3)
edge_length_to_interior = Data(cull_pattern_2)
points_to_exterior = Data(cull_pattern_5)
points_to_interior = Data(cull_pattern_4)
tree_branch_2 = TreeBranch(Tree=simplify(edge_length_to_exterior), Path="{0}", MaintainPaths=True)
point_in_curves = PointInCurves(Point=points_to_interior, Curves=corridor_crv)  # -> Relationship, Index, Point
member_index_2 = MemberIndex(Set=point_in_curves.Relationship, Member=1)  # -> Index, Count
member_index_3 = MemberIndex(Set=point_in_curves.Relationship, Member=2)  # -> Index, Count; disabled
member_index_4 = MemberIndex(Set=point_in_curves.Relationship, Member=0)  # -> Index, Count
trim_tree_2 = TrimTree(Tree=member_index_2.Index, Depth=1)
trim_tree_3 = TrimTree(Tree=member_index_3.Index, Depth=1)  # disabled
trim_tree_4 = TrimTree(Tree=member_index_4.Index, Depth=1)
merge_3 = Merge(Data1=trim_tree_2, Data2=trim_tree_3)
topologic_cell_complex = Data(cellcomplex_bycells)
tree_branch_3 = TreeBranch(Tree=simplify(points_to_exterior), Path="{0}", MaintainPaths=True)
list_item_5 = ListItem(List=edge_length_to_interior, Index=merge_3, Wrap=True)
list_item_6 = ListItem(List=points_to_interior, Index=merge_3, Wrap=True)
edge_length_to_corridor = Data(simplify(list_item_5))
edge_length_to_exterior_2 = Data(simplify(edge_length_to_exterior))
closest_point = ClosestPoint(Point=tree_branch_3, Cloud=flatten(list_item_6))  # -> ClosestPoint, CPIndex, Distance
mass_addition_3 = MassAddition(Input=edge_length_to_corridor)  # -> Result, PartialResults
mass_addition_4 = MassAddition(Input=edge_length_to_exterior_2)  # -> Result, PartialResults
rooms_perimeter = Data(simplify(data))
mass_addition_5 = MassAddition(Input=tree_branch_2)  # -> Result, PartialResults
mass_addition_6 = MassAddition(Input=closest_point.Distance)  # -> Result, PartialResults
list_item_7 = ListItem(List=flatten(mass_addition_3.Result), Index=0, Wrap=True)
panel_6 = Panel(mass_addition_3.Result)
subtraction = Subtraction(A=list_item_7, B=mass_addition_5.Result)
ghpython_script = GhPythonScript(x=mass_addition_6.Result)  # -> out, a
# ---------- ghpython_script: Python ----------
__author__ = "mosta"
__version__ = "2023.06.13"

import rhinoscriptsyntax as rs
if x==0:
    a=1
else:
    a=0
# ---------- end ghpython_script ----------
graph_bytopology = GraphByTopology(
    Topology=topologic_cell_complex,
    Direct=Toggle(True),
    ViaSharedTopologies=Toggle(False),
    ViaSharedApertures=False,
    ToExteriorTopologies=Toggle(False),
    ToExteriorApertures=False,
    UseFaceInternalVertex=False,
    Tolerance=0.0001)
replace_items = ReplaceItems(List=flatten(mass_addition_3.Result), Item=subtraction, Indices=0, Wrap=False)  # -> simplify(graft(List))
stream_filter_3 = StreamFilter(Gate=ghpython_script.a, Stream0=mass_addition_3.Result, Stream1=replace_items)
total_edge_length_to_corridor_room = Data(stream_filter_3)
total_edge_length_to_exterior_room = Data(mass_addition_4.Result)
rooms_perimeter_2 = Data(simplify(rooms_perimeter))
graph_vertices = GraphVertices(Graph=graph_bytopology)
topology_geometry_5 = TopologyGeometry(Topology=graph_vertices, Tolerance=0.0001)
division_2 = Division(A=total_edge_length_to_corridor_room, B=rooms_perimeter_2)
# Edges weights
subtraction_2 = Subtraction(A=rooms_perimeter_2, B=total_edge_length_to_corridor_room, C=total_edge_length_to_exterior_room)
subtraction_3 = Subtraction(A=1, B=division_2)
division_3 = Division(A=total_edge_length_to_exterior_room, B=rooms_perimeter_2)
division_4 = Division(A=subtraction_2, B=rooms_perimeter_2)  # -> flatten(Result)
closest_point_2 = ClosestPoint(Point=topology_geometry_5, Cloud=flatten(area_4.Centroid))  # -> ClosestPoint, CPIndex, Distance
member_index_5 = MemberIndex(Set=closest_point_2.Distance, Member=1.75)  # -> Index, Count
addition_2 = Addition(A=subtraction_3, B=division_3)
list_length_3 = ListLength(List=member_index_5.Index)
tree_branch_4 = TreeBranch(Tree=addition_2, Path="{0}", MaintainPaths=True)
equality_3 = Equality(FirstNumber=list_length_3, SecondNumber=0)  # -> flatten(Equality), Inequality
room_types = Data(simplify(graft(merge_2)))
room_area = Data(simplify(area_4.Area))
list_length_4 = ListLength(List=flatten(addition_2))
ghpython_script_2 = GhPythonScript(x=addition_2)  # -> out, a
# ---------- ghpython_script_2: Python ----------
import rhinoscriptsyntax as rs
if x<=0.4:
    a=0
elif 0.4<x<=0.8:
    a=1
elif 0.8<x<=1.2:
    a=2
elif 1.2<x<=1.6:
    a=3
else:
    a=4
# ---------- end ghpython_script_2 ----------
ghpython_script_3 = GhPythonScript(x=tree_branch_4)  # -> out, a
# ---------- ghpython_script_3: Python ----------
import rhinoscriptsyntax as rs
if x<0.2:
    a=1
else:
    a=0
# ---------- end ghpython_script_3 ----------
integer = Integer(room_types)
member_index_6 = MemberIndex(Set=equality_3.Equality, Member=True)  # -> Index, Count
mass_addition_7 = MassAddition(Input=flatten(addition_2))  # -> Result, PartialResults
mass_addition_8 = MassAddition(Input=flatten(ghpython_script_2.a))  # -> Result, PartialResults
x_minus_one = XMinusOne(NumberX=list_length_4)
replace_items_2 = ReplaceItems(List=flatten(closest_point_2.CPIndex), Item=0, Indices=member_index_6.Index, Wrap=False)
merge_4 = Merge(Data1=integer, Data2=addition_2, Data3=room_area, Data4=rooms_perimeter_2)
sort_list_3 = SortList(Keys=replace_items_2, ValuesValuesA=graph_vertices)  # -> Keys, ValuesValuesA
stream_filter_4 = StreamFilter(Gate=ghpython_script_3.a, Stream0=list_length_4, Stream1=x_minus_one)
division_5 = Division(A=mass_addition_7.Result, B=stream_filter_4)
graph_edges = GraphEdges(Graph=graph_bytopology, Vertices=sort_list_3.ValuesValuesA, Tolerance=0.0001)
topology_geometry_6 = TopologyGeometry(Topology=graph_edges, Tolerance=0.0001)
ghpython_script_4 = GhPythonScript(x=division_5)  # -> out, a
# ---------- ghpython_script_4: Python ----------
import rhinoscriptsyntax as rs
if x<=0.8:
    a=0
elif 0.8<=x<1:
    a=1
elif 1<=x<1.2:
    a=2
elif 1.2<=x:
    a=3
# ---------- end ghpython_script_4 ----------
graph_verticies = Data(sort_list_3.ValuesValuesA)
floor_plan_quaility_indix = Panel(ghpython_script_2.a)
topology_geometry_7 = TopologyGeometry(Topology=graph_verticies, Tolerance=0.0001)
floor_plan_quaility_indix_max_2 = Panel(addition_2)
room_type_score = Panel(merge_4)
point_list_2 = PointList(Points=flatten(topology_geometry_7), Size=Slider(4, range=0..10))
list_item_8 = ListItem(List=merge_4, Index=panel_5, Wrap=True)
edge_vertices = EdgeVertices(Edge=graph_edges)
graph_vertexdegree = GraphVertexDegree(Graph=graph_bytopology, Vertex=graph_verticies)  # -> flatten(Degree)
vertex_coordinates = VertexCoordinates(Vertex=edge_vertices)  # -> simplify(X), simplify(Y), simplify(Z)
vertex_coordinates_2 = VertexCoordinates(Vertex=graph_verticies)  # -> X, Y, Z
python = GhPythonScript(
    vx=vertex_coordinates.X,
    vy=vertex_coordinates.Y,
    vz=vertex_coordinates.Z,
    x=vertex_coordinates_2.X,
    y=vertex_coordinates_2.Y,
    z=vertex_coordinates_2.Z,
    NodesToNeighbourScore=division_4)  # -> out, simplify(edge_verticies), flatten(e_features); inputs vx: tree, vy: tree, vz: tree, x: list, y: list, z: list, NodesToNeighbourScore: list
# ---------- python: Python ----------
import rhinoscriptsyntax as rs
import Rhino.Geometry as rg
import ghpythonlib.treehelpers as th


vx=th.tree_to_list(vx,None)
vy=th.tree_to_list(vy,None)
vz=th.tree_to_list(vz,None)

edge_verticies=[]
for i in range(len(vx)):
    for j in range(len(x)):
        if vx[i][0]==x[j] and vy[i][0]==y[j] and vz[i][0]==z[j]:
            first_node=j
        else:
            pass
        if vx[i][1]==x[j] and vy[i][1]==y[j] and vz[i][1]==z[j]:
            second_node=j
        else:
            pass
    edge_verticies.append([first_node,second_node])
    

### Add edge features, we will average nodes degrees of each edge and set it as an edge feature
e_features=[]
for i in edge_verticies:
    e_feature=(NodesToNeighbourScore[i[0]]+NodesToNeighbourScore[i[1]])/2
    e_features.append(e_feature)
    #print(e_feature)


edge_verticies=th.list_to_tree(edge_verticies)
# ---------- end python ----------
python_2 = GhPythonScript(write=toggle, x=vertex_coordinates_2.X, y=vertex_coordinates_2.Y, z=vertex_coordinates_2.Z, path=path, features=merge_4)  # -> out, a; inputs write: Boolean, x: list, y: list, z: list, features: tree
# ---------- python_2: Python ----------
import rhinoscriptsyntax as rs
import Rhino.Geometry as rg
import csv
import ghpythonlib.treehelpers as th

if write:
    features=th.tree_to_list(features,None)
    
    with open(path, 'wb') as file:
        writer = csv.writer(file)
        writer.writerow(['x','y','z','RoomType','RoomQualit','RoomArea',"RoomPrem"])
        for i in range(len(x)):
           writer.writerow([x[i], y[i], z[i], features[i][0],features[i][1],features[i][2],features[i][3]])
        file.close
# ---------- end python_2 ----------
panel_7 = Panel(python.e_features)
panel_8 = Panel(python.edge_verticies)
# Graph Viz
topology_geometry_8 = TopologyGeometry(Topology=graph_edges, Tolerance=0.0001)
topology_geometry_9 = TopologyGeometry(Topology=graph_verticies, Tolerance=0.0001)
# Geometry Viz
deconstruct_brep = DeconstructBrep(Brep=cull_index_2)  # -> Faces, Edges, Vertices
python_3 = GhPythonScript(write=toggle, v=python.edge_verticies, path=path, features_1=python.e_features)  # -> out, a; inputs write: Boolean, v: tree of Int32, features_1: list
# ---------- python_3: Python ----------
import rhinoscriptsyntax as rs
import Rhino.Geometry as rg
import csv
import ghpythonlib.treehelpers as th

v=th.tree_to_list(v,None)

if write:
    with open(path, 'wb') as file:
        writer = csv.writer(file)
        writer.writerow(['vi','vj','feature_1'])
        for i in range(len(v)):
           writer.writerow([v[i][0], v[i][1], features_1[i]])
        file.close
# ---------- end python_3 ----------
custom_preview_materials = CustomPreviewMaterials(Geometry=cull_index_2, DiffuseColor=colour_swatch_2, Transparency=Slider(0.8, range=0..1))
custom_preview_materials_2 = CustomPreviewMaterials(
    Geometry=list_item_2,
    DiffuseColor=ColourSwatch(SwatchColor=RGBA(255, 225, 0, 164)),
    Transparency=Slider(0.5, range=0..1))
custom_preview_lineweights_3 = CustomPreviewLineweights(Geometry=deconstruct_brep.Edges, Shader=colour_swatch_2, Absolute=False)
# Automate
python_4 = GhPythonScript(v=python.edge_verticies, features_1=python.e_features)  # -> out, a; inputs v: tree of Int32, features_1: list
# ---------- python_4: Python ----------
import json
import ghpythonlib.treehelpers as th

v=th.tree_to_list(v,None)
node_list = []

for i in range(len(v)):
   node_list.append( json.dumps([v[i][0], v[i][1], features_1[i]]) )

a = node_list
b = json.dumps(features_1)
# ---------- end python_4 ----------
python_5 = GhPythonScript(x=vertex_coordinates_2.X, y=vertex_coordinates_2.Y, z=vertex_coordinates_2.Z, features=merge_4)  # -> out, a; inputs x: list, y: list, z: list, features: tree
# ---------- python_5: Python ----------
import json
import ghpythonlib.treehelpers as th


features=th.tree_to_list(features,None)
edge_list = []

for i in range(len(x)):
   edge_list.append( json.dumps([x[i], y[i], z[i], features[i][0],features[i][1],features[i][2],features[i][3]]))


a =edge_list
# ---------- end python_5 ----------
python_6 = GhPythonScript(x=vertex_coordinates_2.X, y=vertex_coordinates_2.Y, z=vertex_coordinates_2.Z, features=merge_4)  # -> out, simplify(flatten(a)); inputs x: list, y: list, z: list, features: tree
# ---------- python_6: Python ----------
import json
import ghpythonlib.treehelpers as th


features=th.tree_to_list(features,None)
edge_list = []

for i in range(len(x)):
   edge_list.append( json.dumps([x[i], y[i], z[i], features[i][0],features[i][1]]))


a =edge_list
# ---------- end python_6 ----------
stream_filter_5 = StreamFilter(
    Gate=ghpython_script_4.a,
    Stream0=ColourSwatch(SwatchColor=RGB(204, 3, 0)),
    Stream1=ColourSwatch(SwatchColor=RGB(255, 123, 0)),
    Stream2=ColourSwatch(SwatchColor=RGB(18, 173, 3)),
    Stream3=ColourSwatch(SwatchColor=RGB(15, 112, 209)))
previewlw = CustomPreviewLineweights(
    Geometry=topology_geometry_8,
    Shader=ColourSwatch(SwatchColor=RGB(0, 0, 0)),
    Thickness=Slider(2.23, range=0..10),
    Absolute=False)
dots = DotDisplay(Point=topology_geometry_9, Colour=ColourSwatch(SwatchColor=RGB(0, 0, 0)), Size=Slider(0.39, range=0..10))
context_print = ContextPrint(Nodes=python_5.a)
context_print_2 = ContextPrint(Edges=python_4.a)
nodes_to_predict = Panel(python_6.a)
edges_to_predict = Panel(python_4.a)
previewlw_2 = CustomPreviewLineweights(Geometry=topology_geometry_8, Shader=stream_filter_5, Thickness=Slider(4.59, range=0..10), Absolute=False)
actual_class = Panel(ghpython_script_4.a)
actual_efficency_score = Panel(multiplication_2)

concatenate = Concatenate(FragmentA="https://1276-35-185-42-222.ngrok.io", FragmentB="/Plan_Eval")
# Predicting quality using hops
hops = Hops(
    _Path=concatenate,
    Graph_node_list=nodes_to_predict,
    Graph_edge_list=edges_to_predict,
    CacheResultsInMemory=True,
    CacheSolveResults=True,
    RemoteDefinitionLocation="https://1276-35-185-42-222.ngrok.io/Plan_Eval",
    RemoteSolveVersion=(0, 1, 0),
    ShowInput_Enabled=False,
    ShowInput_Path=True,
    SynchronousSolve=True)

predicted_class = Panel(hops)

# ----
# solver
seed = Slider(300, range=300..500)
unit_z_2 = UnitZ(Factor=3.5)

# ----
# (1- to corridor %)
# +
# to exterior %
# Capturing graph attributes
# Input
# parameters
# Corridor_area%
# Geometry Viz
# Data Set Range
# Make sure to reconnect the realtion below !
# Edges weights
# Plan Generator
# Graph generation
# Graph export
number_slider = Slider(1, range=0..100)
panel_12 = Panel("""0
1""")
colour_swatch_3 = ColourSwatch(SwatchColor=RGB(255, 123, 0))
colour_swatch_4 = ColourSwatch(SwatchColor=RGB(255, 251, 0))
colour_swatch_5 = ColourSwatch(SwatchColor=RGB(18, 133, 0))

seed_2 = GetNumber(number_slider, AtLeast=1, AtMost=1, Maximum=1.797693135e+308, Minimum=-1.797693135e+308, TreeAccess=False)
magnetizing_fpg = MagnetizingRooms_ES(HouseInstance=stream_filter_2, Iterations=seed_2, MaxAdjDistance="3", CellSizeM=1)  # -> Corridors, RoomBreps, RoomNames, Adjacencies, MissingAdjacences, Boundary, BoundaryOffset
corridor_2 = Brep(magnetizing_fpg.Corridors)
rooms_2 = Brep(magnetizing_fpg.RoomBreps)
merge_faces_3 = MergeFaces(Brep=rooms_2)  # -> Breps, Before, After
merge_faces_4 = MergeFaces(Brep=corridor_2)  # -> Breps, Before, After
merge_5 = Merge(Data1=flatten(merge_faces_4.Breps), Data2=flatten(merge_faces_3.Breps))
extrude_2 = Extrude(Base=merge_5, Direction=unit_z_2)
flatten_tree_2 = FlattenTree(Tree=extrude_2, Path="{0}")
topology_bygeometry_2 = TopologyByGeometry(Geometry=extrude_2, Tolerance=0.0001)  # -> flatten(Topology)
list_item_9 = ListItem(List=flatten_tree_2, Index=0, Wrap=True)
cull_index_3 = CullIndex(List=flatten_tree_2, Indices=0, Wrap=True)
topology_cells_2 = TopologyCells(Topology=topology_bygeometry_2)  # -> flatten(Cells)
cellcomplex_bycells_2 = CellComplexByCells(Cells=topology_cells_2)

# ---- group: Getting ground faces without duplicate edges
cellcomplex_faces_2 = CellComplexFaces(CellComplex=cellcomplex_bycells_2)
topology_geometry_10 = TopologyGeometry(Topology=cellcomplex_faces_2, Tolerance=0.0001)  # -> flatten(Geometry)
area_5 = Area(Geometry=topology_geometry_10)  # -> Area, Centroid
deconstruct_2 = Deconstruct(Point=area_5.Centroid)  # -> XComponent, YComponent, ZComponent
equality_4 = Equality(FirstNumber=deconstruct_2.ZComponent, SecondNumber=0)  # -> Equality, Inequality
cull_pattern_6 = CullPattern(List=cellcomplex_faces_2, CullPattern=equality_4.Equality)

# ---- group: Face shared edges with itself to get each faces edges
face_sharededges_2 = FaceSharedEdges(Face=cull_pattern_6, Face_2=cull_pattern_6)
topology_geometry_11 = TopologyGeometry(Topology=face_sharededges_2, Tolerance=0.0001)
trim_tree_5 = TrimTree(Tree=topology_geometry_11, Depth=1)

# ---- group: Edge Classification to exterior and Interior edges
curve_middle_2 = CurveMiddle(Curve=trim_tree_5)
length_4 = Length(Curve=trim_tree_5)
list_length_5 = ListLength(List=trim_tree_5)
member_index_7 = MemberIndex(Set=flatten(curve_middle_2), Member=flatten(curve_middle_2))  # -> Index, Count
partition_list_2 = PartitionList(List=member_index_7.Count, Size=flatten(list_length_5))
equality_5 = Equality(FirstNumber=partition_list_2, SecondNumber=2)  # -> Equality, Inequality

# ----
cull_pattern_7 = CullPattern(List=length_4, CullPattern=equality_5.Equality)
cull_pattern_8 = CullPattern(List=length_4, CullPattern=equality_5.Inequality)
cull_pattern_9 = CullPattern(List=curve_middle_2, CullPattern=equality_5.Equality)
cull_pattern_10 = CullPattern(List=curve_middle_2, CullPattern=equality_5.Inequality)

deconstruct_brep_2 = DeconstructBrep(Brep=cull_index_3)  # -> Faces, Edges, Vertices
colour_swatch_6 = ColourSwatch(SwatchColor=RGBA(36, 36, 36, 165))
custom_preview_materials_3 = CustomPreviewMaterials(Geometry=cull_index_3, DiffuseColor=colour_swatch_6, Transparency=Slider(0.8, range=0..1))
custom_preview_materials_4 = CustomPreviewMaterials(
    Geometry=list_item_9,
    DiffuseColor=ColourSwatch(SwatchColor=RGBA(255, 225, 0, 164)),
    Transparency=Slider(0.5, range=0..1))
custom_preview_lineweights_4 = CustomPreviewLineweights(Geometry=deconstruct_brep_2.Edges, Shader=colour_swatch_6, Absolute=False)

# ----
# Room type
# Room Quality
# Room Area
# Room premiter
# Quality
# efficiency
# Floor plan Area
list_length_6 = ListLength(List=magnetizing_fpg.RoomNames)
repeat_data_2 = RepeatData(Data=Slider(1, range=0..1), Length=list_length_6)
merge_6 = Merge(Data1=flatten(Slider(0, range=0..100)), Data2=flatten(repeat_data_2))
list_item_10 = ListItem(List=topology_geometry_10, Index=0, Wrap=True)
topology_geometry_12 = TopologyGeometry(Topology=cull_pattern_6, Tolerance=0.0001)
list_item_11 = ListItem(List=flatten(topology_geometry_12), Index=0, Wrap=True)
tree_branch_5 = TreeBranch(Tree=simplify(trim_tree_5), Path="{0}", MaintainPaths=True)
topology_geometry_13 = TopologyGeometry(Topology=cull_pattern_6, Tolerance=0.0001)  # -> simplify(Geometry)
join_curves_2 = JoinCurves(Curves=tree_branch_5, Preserve=False)  # -> flatten(Curves)
mass_addition_9 = MassAddition(Input=length_4)  # -> Result, PartialResults
length_5 = Length(Curve=join_curves_2)
data_2 = Data(mass_addition_9.Result)
sort_list_4 = SortList(Keys=length_5, ValuesValuesA=join_curves_2)  # -> Keys, ValuesValuesA
area_6 = Area(Geometry=topology_geometry_13)  # -> Area, Centroid
corridor_crv_2 = Curve(sort_list_4.ValuesValuesA)
point_list_3 = PointList(Points=flatten(area_6.Centroid), Size=Slider(4, range=0..10))
edge_length_to_exterior_3 = Data(cull_pattern_8)
edge_length_to_interior_2 = Data(cull_pattern_7)
points_to_exterior_2 = Data(cull_pattern_10)
points_to_interior_2 = Data(cull_pattern_9)
edge_length_to_exterior_4 = Data(simplify(edge_length_to_exterior_3))
mass_addition_10 = MassAddition(Input=edge_length_to_exterior_4)  # -> Result, PartialResults
rooms_perimeter_3 = Data(simplify(data_2))
room_types_2 = Data(simplify(graft(merge_6)))
room_area_2 = Data(simplify(area_6.Area))
integer_2 = Integer(room_types_2)

# ---- group: Classifying Interior points to corridors and neighbours
point_in_curves_2 = PointInCurves(Point=points_to_interior_2, Curves=corridor_crv_2)  # -> Relationship, Index, Point
member_index_8 = MemberIndex(Set=point_in_curves_2.Relationship, Member=1)  # -> Index, Count
member_index_9 = MemberIndex(Set=point_in_curves_2.Relationship, Member=2)  # -> Index, Count; disabled
trim_tree_6 = TrimTree(Tree=member_index_8.Index, Depth=1)
trim_tree_7 = TrimTree(Tree=member_index_9.Index, Depth=1)  # disabled
merge_7 = Merge(Data1=trim_tree_6, Data2=trim_tree_7)
list_item_12 = ListItem(List=edge_length_to_interior_2, Index=merge_7, Wrap=True)

# ----
tree_branch_6 = TreeBranch(Tree=simplify(edge_length_to_exterior_3), Path="{0}", MaintainPaths=True)
member_index_10 = MemberIndex(Set=point_in_curves_2.Relationship, Member=0)  # -> Index, Count
trim_tree_8 = TrimTree(Tree=member_index_10.Index, Depth=1)
topologic_cell_complex_2 = Data(cellcomplex_bycells_2)
tree_branch_7 = TreeBranch(Tree=simplify(points_to_exterior_2), Path="{0}", MaintainPaths=True)
mass_addition_11 = MassAddition(Input=tree_branch_6)  # -> Result, PartialResults

list_item_13 = ListItem(List=points_to_interior_2, Index=merge_7, Wrap=True)
edge_length_to_corridor_2 = Data(simplify(list_item_12))
mass_addition_12 = MassAddition(Input=edge_length_to_corridor_2)  # -> Result, PartialResults

closest_point_3 = ClosestPoint(Point=tree_branch_7, Cloud=flatten(list_item_13))  # -> ClosestPoint, CPIndex, Distance
mass_addition_13 = MassAddition(Input=closest_point_3.Distance)  # -> Result, PartialResults
list_item_14 = ListItem(List=flatten(mass_addition_12.Result), Index=0, Wrap=True)
panel_13 = Panel(mass_addition_12.Result)
subtraction_4 = Subtraction(A=list_item_14, B=mass_addition_11.Result)
ghpython_script_5 = GhPythonScript(x=mass_addition_13.Result)  # -> out, a; same code as ghpython_script
replace_items_3 = ReplaceItems(List=flatten(mass_addition_12.Result), Item=subtraction_4, Indices=0, Wrap=False)  # -> simplify(graft(List))
stream_filter_6 = StreamFilter(Gate=ghpython_script_5.a, Stream0=mass_addition_12.Result, Stream1=replace_items_3)

# ---- group: Edge lengths for analysis per each room
total_edge_length_to_corridor_room_2 = Data(stream_filter_6)
total_edge_length_to_exterior_room_2 = Data(mass_addition_10.Result)
rooms_perimeter_4 = Data(simplify(rooms_perimeter_3))

# ----
subtraction_5 = Subtraction(A=rooms_perimeter_4, B=total_edge_length_to_corridor_room_2, C=total_edge_length_to_exterior_room_2)
division_6 = Division(A=subtraction_5, B=rooms_perimeter_4)  # -> flatten(Result)

graph_bytopology_2 = GraphByTopology(
    Topology=topologic_cell_complex_2,
    Direct=Toggle(True),
    ViaSharedTopologies=Toggle(False),
    ViaSharedApertures=False,
    ToExteriorTopologies=Toggle(False),
    ToExteriorApertures=False,
    UseFaceInternalVertex=False,
    Tolerance=0.0001)

# ---- group: Sorting graph verticies
graph_vertices_2 = GraphVertices(Graph=graph_bytopology_2)
topology_geometry_14 = TopologyGeometry(Topology=graph_vertices_2, Tolerance=0.0001)
closest_point_4 = ClosestPoint(Point=topology_geometry_14, Cloud=flatten(area_6.Centroid))  # -> ClosestPoint, CPIndex, Distance
member_index_11 = MemberIndex(Set=closest_point_4.Distance, Member=1.75)  # -> Index, Count
list_length_7 = ListLength(List=member_index_11.Index)
equality_6 = Equality(FirstNumber=list_length_7, SecondNumber=0)  # -> flatten(Equality), Inequality
member_index_12 = MemberIndex(Set=equality_6.Equality, Member=True)  # -> Index, Count
replace_items_4 = ReplaceItems(List=flatten(closest_point_4.CPIndex), Item=0, Indices=member_index_12.Index, Wrap=False)
sort_list_5 = SortList(Keys=replace_items_4, ValuesValuesA=graph_vertices_2)  # -> Keys, ValuesValuesA

# ----
graph_edges_2 = GraphEdges(Graph=graph_bytopology_2, Vertices=sort_list_5.ValuesValuesA, Tolerance=0.0001)
topology_geometry_15 = TopologyGeometry(Topology=graph_edges_2, Tolerance=0.0001)
graph_verticies_2 = Data(sort_list_5.ValuesValuesA)
topology_geometry_16 = TopologyGeometry(Topology=graph_verticies_2, Tolerance=0.0001)
point_list_4 = PointList(Points=flatten(topology_geometry_16), Size=Slider(4, range=0..10))

# ----
# Graph Viz
topology_geometry_17 = TopologyGeometry(Topology=graph_edges_2, Tolerance=0.0001)
topology_geometry_18 = TopologyGeometry(Topology=graph_verticies_2, Tolerance=0.0001)
previewlw_3 = CustomPreviewLineweights(
    Geometry=topology_geometry_17,
    Shader=ColourSwatch(SwatchColor=RGB(0, 0, 0)),
    Thickness=Slider(2.23, range=0..10),
    Absolute=False)
dots_2 = DotDisplay(Point=topology_geometry_18, Colour=ColourSwatch(SwatchColor=RGB(0, 0, 0)), Size=Slider(0.39, range=0..10))

corridor_3 = Brep(magnetizing_fpg.Corridors)
brep = Brep(magnetizing_fpg.Corridors)
brep_2 = Brep(magnetizing_fpg.RoomBreps)
area_7 = Area(Geometry=brep)  # -> flatten(Area), Centroid
area_8 = Area(Geometry=brep_2)  # -> flatten(Area), Centroid
area_9 = Area(Geometry=corridor_3)  # -> Area, Centroid
mass_addition_14 = MassAddition(Input=[area_8.Area, area_7.Area])  # -> Result, PartialResults

# ---- group: corridor area
panel_14 = Panel(area_9.Area)

# ----
division_7 = Division(A=panel_14, B=mass_addition_14.Result)

# ---- group: corridor_area%
panel_15 = Panel(division_7)

# ----
division_8 = Division(A=total_edge_length_to_corridor_room_2, B=rooms_perimeter_4)
subtraction_6 = Subtraction(A=1, B=division_8)
division_9 = Division(A=total_edge_length_to_exterior_room_2, B=rooms_perimeter_4)
corridor_4 = Data(panel_15)
number = Number(corridor_4)
floor_plan_area = Data(mass_addition_14.Result)
ghpython_script_6 = GhPythonScript(x=number)  # -> out, a
# ---------- ghpython_script_6: Python ----------
import rhinoscriptsyntax as rs
if x<=0.2:
    a=4
elif 0.2<x<=0.4:
    a=3
elif 0.4<x<=0.6:
    a=2
elif 0.6<x<=0.8:
    a=1
else:
    a=0
# ---------- end ghpython_script_6 ----------
panel_16 = Panel(ghpython_script_6.a)

# ---- group: Floor Plan Quaility Indix-- Max 2
addition_3 = Addition(A=subtraction_6, B=division_9)

# ----
tree_branch_8 = TreeBranch(Tree=addition_3, Path="{0}", MaintainPaths=True)
list_length_8 = ListLength(List=flatten(addition_3))
ghpython_script_7 = GhPythonScript(x=addition_3)  # -> out, a; same code as ghpython_script_2
ghpython_script_8 = GhPythonScript(x=tree_branch_8)  # -> out, a; same code as ghpython_script_3
mass_addition_15 = MassAddition(Input=flatten(addition_3))  # -> Result, PartialResults
mass_addition_16 = MassAddition(Input=flatten(ghpython_script_7.a))  # -> Result, PartialResults
x_minus_one_2 = XMinusOne(NumberX=list_length_8)
merge_8 = Merge(Data1=integer_2, Data2=addition_3, Data3=room_area_2, Data4=rooms_perimeter_4)
stream_filter_7 = StreamFilter(Gate=ghpython_script_8.a, Stream0=list_length_8, Stream1=x_minus_one_2)
division_10 = Division(A=mass_addition_15.Result, B=stream_filter_7)
merge_9 = Merge(Data1=simplify(division_10), Data2=simplify(flatten(ghpython_script_6.a)), Data3=flatten(floor_plan_area))
graph_quality_efficiency_score = Panel(merge_9)
room_type_score_2 = Panel(merge_8)

# ---- group: For Classification
ghpython_script_9 = GhPythonScript(x=division_10)  # -> out, a; same code as ghpython_script_4

# ----
# Automate
# Room type
# Room Quality
# Room Area
# Quality
# efficiency
# Floor plan Area
edge_vertices_2 = EdgeVertices(Edge=graph_edges_2)
toggle_2 = BooleanToggle(False)
path_2 = FilePath("E:\IAAC\course\AI\graph\sample_auto\edge.csv")
graph_vertexdegree_2 = GraphVertexDegree(Graph=graph_bytopology_2, Vertex=graph_verticies_2)  # -> flatten(Degree)
vertex_coordinates_3 = VertexCoordinates(Vertex=edge_vertices_2)  # -> simplify(X), simplify(Y), simplify(Z)
vertex_coordinates_4 = VertexCoordinates(Vertex=graph_verticies_2)  # -> X, Y, Z
python_7 = GhPythonScript(
    vx=vertex_coordinates_3.X,
    vy=vertex_coordinates_3.Y,
    vz=vertex_coordinates_3.Z,
    x=vertex_coordinates_4.X,
    y=vertex_coordinates_4.Y,
    z=vertex_coordinates_4.Z,
    NodesToNeighbourScore=division_6)  # -> out, simplify(edge_verticies), flatten(e_features); inputs vx: tree, vy: tree, vz: tree, x: list, y: list, z: list, NodesToNeighbourScore: list; same code as python
python_8 = GhPythonScript(
    write=toggle_2,
    x=vertex_coordinates_4.X,
    y=vertex_coordinates_4.Y,
    z=vertex_coordinates_4.Z,
    path=path_2,
    features=merge_8)  # -> out, a; inputs write: Boolean, x: list, y: list, z: list, features: tree; same code as python_2
python_9 = GhPythonScript(write=toggle_2, v=python_7.edge_verticies, path=path_2, features_1=python_7.e_features)  # -> out, a; inputs write: Boolean, v: tree of Int32, features_1: list; same code as python_3
python_10 = GhPythonScript(write=toggle_2, path=path_2, features=merge_9)  # -> out, a; inputs write: Boolean, x: list, y: list, z: list, features: tree
# ---------- python_10: Python ----------
import rhinoscriptsyntax as rs
import Rhino.Geometry as rg
import csv
import ghpythonlib.treehelpers as th

features=th.tree_to_list(features,None)

if write:
    with open(path, 'wb') as file:
        writer = csv.writer(file)
        writer.writerow(['PlanQualt','PlanEff','PlanArea'])
        for i in range(len(features)):
           writer.writerow([features[i][0],features[i][1],features[i][2]])
        file.close
# ---------- end python_10 ----------

panel_17 = Panel(mass_addition_14.Result)
plan_quality = Panel(division_10)
plan_efficiency = Panel(corridor_4)
floor_plan_quaility_indix_2 = Panel(ghpython_script_7.a)
floor_plan_quaility_indix_max_2_2 = Panel(addition_3)
list_item_15 = ListItem(List=merge_8, Index=panel_12, Wrap=True)
panel_18 = Panel(python_7.e_features)
panel_19 = Panel(python_7.edge_verticies)

stream_filter_8 = StreamFilter(
    Gate=ghpython_script_9.a,
    Stream0=ColourSwatch(SwatchColor=RGB(204, 3, 0)),
    Stream1=ColourSwatch(SwatchColor=RGB(255, 123, 0)),
    Stream2=ColourSwatch(SwatchColor=RGB(18, 173, 3)),
    Stream3=ColourSwatch(SwatchColor=RGB(15, 112, 209)))
previewlw_4 = CustomPreviewLineweights(Geometry=topology_geometry_17, Shader=stream_filter_8, Thickness=Slider(4.59, range=0..10), Absolute=False)

python_11 = GhPythonScript(v=python_7.edge_verticies, features_1=python_7.e_features)  # -> out, a; inputs v: tree of Int32, features_1: list; same code as python_4
python_12 = GhPythonScript(x=vertex_coordinates_4.X, y=vertex_coordinates_4.Y, z=vertex_coordinates_4.Z, features=merge_8)  # -> out, a; inputs x: list, y: list, z: list, features: tree; same code as python_5
python_13 = GhPythonScript(features=merge_9)  # -> out, a; inputs features: tree
# ---------- python_13: Python ----------
import json
import ghpythonlib.treehelpers as th


features=th.tree_to_list(features,None)
graph_list = []

for i in range(len(features)):
   graph_list.append( json.dumps([features[i][0],features[i][1],features[i][2]]))


a =graph_list
# ---------- end python_13 ----------
context_print_3 = ContextPrint(Nodes=python_12.a)
context_print_4 = ContextPrint(Graph=python_13.a)
context_print_5 = ContextPrint(Edges=python_11.a)

# ---- group: For Verification
python_14 = GhPythonScript(x=vertex_coordinates_4.X, y=vertex_coordinates_4.Y, z=vertex_coordinates_4.Z, features=merge_8)  # -> out, simplify(flatten(a)); inputs x: list, y: list, z: list, features: tree; same code as python_6
